# Dynamo graph 00.SerializeElement.dyn (Dynamo 2.15.0.5383)
# packages: AU2022Dynamo 1.0.0

number_slider = DoubleSlider(2.6, range=-20..20 step 0.1)
number_slider_2 = DoubleSlider(2.6, range=-20..20 step 0.1)
number_slider_3 = DoubleSlider(2.6, range=-20..20 step 0.1)
create = Core.Placement.Create(x=number_slider, y=number_slider_2, z=number_slider_3)
number_slider_4 = DoubleSlider(2.6, range=0.1..20 step 0.1)
number_slider_5 = DoubleSlider(2.6, range=0.1..20 step 0.1)
number_slider_6 = DoubleSlider(2.6, range=0.1..20 step 0.1)
create_2 = Elements.Footing.Create(placement=create, width=number_slider_4, length=number_slider_5, depth=number_slider_6)
parseJSON = Data.ParseJSON(json=create_2.json)
file_path = Filename(".\00.SerializeElement.json")
writeText = FileSystem.WriteText(filePath=file_path, text=create_2.json)
faces = Topology.Faces(topology=create_2.solid)
vertices = Face.Vertices(face=faces)
